# Dynamo graph 01-STR-ARC-ELEVATION.dyn (Dynamo 2.5.0.7460)
# packages: bimorphNodes 4.0.13

convert_between_units = DynamoConvert(MeasurementType="Length", FromConversion="Meters", ToConversion="Millimeters")
select_excel_file = Filename("C:\Users\kheng\Desktop\Level Marker.R1.xlsx")  # graph input
file_from_path = FileObject(path=select_excel_file)
code_block = CodeBlock { "Level Marker"; }
boolean = BoolSelector(true)
importExcel = Data.ImportExcel(file=file_from_path, sheetName=code_block, readAsStrings=boolean, showExcel=boolean)
restOfItems = List.RestOfItems(list=importExcel)
code_block_2 = CodeBlock { 1; }
getItemAtIndex = List.GetItemAtIndex(list=restOfItems, index=code_block_2, lacing=Longest)
elevation = Watch(getItemAtIndex)
toNumber = String.ToNumber(str=elevation)
code_block_3 = CodeBlock { 0; }
getItemAtIndex_2 = List.GetItemAtIndex(list=restOfItems, index=code_block_3, lacing=Longest)
level_name = Watch(getItemAtIndex_2)
byElevationAndName = Level.ByElevationAndName(elevation=toNumber, name=level_name)
code_block_4 = CodeBlock { "Connect from String.ToNumber to Level.ByElevationAndName"; "If you want to convert it into other Units"; }
select_dwg = DSModelElementSelection()  # nothing selected; graph input

# group: Select File CAD
layerNames = Revit.ImportInstance.LayerNames(importInstance=select_dwg)
gridline_layer_use_for_multiple = StringInput("Gridline")  # "Gridline Layer (Use "," for multiple layers)"; graph input
code_block_5 = CodeBlock { ","; }
split = String.Split(str=gridline_layer_use_for_multiple, separator0=code_block_5)
# note: BimorphNodes Package
curvesFromCADLayers = CAD.CurvesFromCADLayers(importInstance=select_dwg, layerNames=split)

flatten = List.Flatten(list=curvesFromCADLayers.Curve)
code_block_6 = CodeBlock { "Line"; }
removeIfNot = List.RemoveIfNot(list=flatten, type=code_block_6)
length = Curve.Length(curve=removeIfNot)
code_block_7 = CodeBlock { 500; }
ge = length >= code_block_7
filterByBoolMask = List.FilterByBoolMask(list=removeIfNot, mask=ge)
code_block_8 = CodeBlock(a=filterByBoolMask.in) { a; }
byLine = Grid.ByLine(line=code_block_8)
current = Document.Current()
activeView = Document.ActiveView(document=current)
categories = Categories("OST_Grids")  # graph input
all_elements_of_category = ElementsOfCategory(Category=categories)
curve = Grid.Curve(grid=all_elements_of_category)
direction = Line.Direction(line=curve)
X = Vector.X(vector=direction)
round = Math.Round(number=X)
vertical_grids = CodeBlock(x=round) { x==0; }
filterByBoolMask_2 = List.FilterByBoolMask(list=all_elements_of_category, mask=vertical_grids)
byGeometry = BoundingBox.ByGeometry(geom=curve)
maxPoint = BoundingBox.MaxPoint(boundingBox=byGeometry)
YAxis = Vector.YAxis()
minPoint = BoundingBox.MinPoint(boundingBox=byGeometry)
distanceTo = Geometry.DistanceTo(geometry=maxPoint, other=minPoint)
byStartPointDirectionLength = Line.ByStartPointDirectionLength(startPoint=maxPoint, direction=YAxis, length=distanceTo)
XAxis = Vector.XAxis()
code_block_9 = CodeBlock { 1000; }
translate = Geometry.Translate(geometry=byStartPointDirectionLength, direction=XAxis, distance=code_block_9)
byElements = Dimension.ByElements(view=activeView, referenceElements=filterByBoolMask_2.in, line=translate)
Y = Vector.Y(vector=direction)
round_2 = Math.Round(number=Y)
horizontal_grids = CodeBlock(y=round_2) { y==0; }
filterByBoolMask_3 = List.FilterByBoolMask(list=all_elements_of_category, mask=horizontal_grids)
byStartPointDirectionLength_2 = Line.ByStartPointDirectionLength(startPoint=minPoint, direction=XAxis, length=distanceTo)
code_block_10 = CodeBlock(n1=code_block_9) { n1; }
translate_2 = Geometry.Translate(geometry=byStartPointDirectionLength_2, direction=YAxis, distance=code_block_10)
byElements_2 = Dimension.ByElements(view=activeView, referenceElements=filterByBoolMask_3.in, line=translate_2)

# group: Message
boolean_2 = BoolSelector(true)
code_block_11 = CodeBlock { Osmode: int = 169; }
pickPoint = Python(IN[0]=boolean_2, IN[1]=boolean_2, IN[2]=code_block_11, IN[3]=code_block_11)  # "UI.PickPoint"
# ---------- pickPoint.python (38 lines) ----------
#LinkDWG Core DYF by Koz Jono YEOH
#kozmosovia@hotmail.com
#Copyright(C) 1994-2020 KozMos Inc.
#Copyright(C) 2011-2020 Neila Heaven Networks
#Copyright(C) 2017-2020 Tachyon Intelligent Design Institute

import clr
clr.AddReference('ProtoGeometry')
from Autodesk.DesignScript.Geometry import *
import System
clr.AddReference('System.Windows.Forms')
from System.Windows.Forms import MessageBox

msg=IN[2]
osm=IN[3]
doc=System.Runtime.InteropServices.Marshal.GetActiveObject("Autocad.Application").ActiveDocument
rrr=None

if IN[0] == True and doc:
	try:
		if IN[1] == True:
			mbx="CamboBIM Consultant and Training Center: We have many courses such as AutoCAD, ASD, Advance Concrete, Revit, Naviswork, BIM-QS, Planning and Cost Control, Primavera P6, Project Tracker, and  Synchro Pro.Our Contact: Email: khengsengngon@gmail.com,Telephone: 069901004, Telegram:https://t.me/KHENGSENGNGORN"
			MessageBox.Show(mbx, "CamboBIM Consultant and Training Center")
		old=doc.GetVariable("osmode")
		usr=doc.GetVariable("users5")
		doc.SetVariable("osmode", int(osm))
		doc.Activate()
		doc.SendCommand("(setq pt(getpoint\042" + msg + "\042)) ")
		doc.SendCommand("(and pt(setvar\042users5\042(strcat(rtos(car pt))\042#\042(rtos(cadr pt))\042#\042(rtos(caddr pt))))(setq pt nil)) ")
		rtn=doc.GetVariable("users5")
		doc.SetVariable("osmode", old)
		if rtn != usr:
			rtn=rtn.split("#")
			if len(rtn) == 3:
				rrr=Point.ByCoordinates(float(rtn[0]),float(rtn[1]),float(rtn[2]))
				doc.SetVariable("users5", usr)
	except: pass	
OUT = rrr
# ----------------------------------------
