# Dynamo graph 02-STR-CAD2BORED PILE.dyn (Dynamo 2.5.0.7460)
# packages: bimorphNodes 4.1.0, KYSUDO.com 21.0.8

select_dwg = DSModelElementSelection()  # 1 picked in the model; graph input

# group: GET CAD LAYER
layerNames = Revit.ImportInstance.LayerNames(importInstance=select_dwg)
wall_layer_use_for_multiple = StringInput("Bored Pile")  # "Wall Layer (Use "," for multiple layers)"; graph input
code_block = CodeBlock { ","; }
split = String.Split(str=wall_layer_use_for_multiple, separator0=code_block)
curvesFromCADLayers = CAD.CurvesFromCADLayers(importInstance=select_dwg, layerNames=split)
flatten = List.Flatten(list=curvesFromCADLayers.Curve)

# group: GET FAMILY PILE BY DIAMETER
family_types = FamilyTypes("M_Pile Cap-1 Pile:1000 x 1000 x 900mm")  # graph input
family = FamilyType.Family(familyType=family_types)
types = Family.Types(family=family)
code_block_2 = CodeBlock { "Width"; }
getParameterValueByName = Element.GetParameterValueByName(element=types, parameterName=code_block_2)
string_from_object = FromObject(obj=getParameterValueByName)
radius = Circle.Radius(circle=flatten)
code_block_3 = CodeBlock(a=radius) { 2*a; }
code_block_4 = CodeBlock { 10; }
roundVIP = Custom[RoundVIP](number=code_block_3, round=code_block_4)  # package KYSUDO.com
string_from_object_2 = FromObject(obj=roundVIP)
indexOf = List.IndexOf(list=string_from_object, element=string_from_object_2, lacing=Longest)
getItemAtIndex = List.GetItemAtIndex(list=types, index=indexOf)

centerPoint = Circle.CenterPoint(circle=flatten)

# group: GET PILE INSERTION PIONT (ROUND)
X = Point.X(point=centerPoint)
Y = Point.Y(point=centerPoint)
list_create = List.Create(item0=X, item1=Y)
code_block_5 = CodeBlock { 10; }
roundVIP_2 = Custom[RoundVIP](number=list_create, round=code_block_5)
code_block_6 = CodeBlock(a=roundVIP_2) { a[0]; }
code_block_7 = CodeBlock(a=roundVIP_2) { a[1]; }
Z = Point.Z(point=centerPoint)
byCoordinates = Point.ByCoordinates(x=code_block_6, y=code_block_7, z=Z)

levels = Levels("Basement Floor")  # graph input
byPointAndLevel = FamilyInstance.ByPointAndLevel(familyType=getItemAtIndex, point=byCoordinates, level=levels)

# group: Message
boolean = BoolSelector(true)
code_block_8 = CodeBlock { Osmode: int = 169; }
pickPoint = Python(IN[0]=boolean, IN[1]=boolean, IN[2]=code_block_8, IN[3]=code_block_8)  # "UI.PickPoint"
# ---------- pickPoint.python (38 lines) ----------
#LinkDWG Core DYF by Koz Jono YEOH
#kozmosovia@hotmail.com
#Copyright(C) 1994-2020 KozMos Inc.
#Copyright(C) 2011-2020 Neila Heaven Networks
#Copyright(C) 2017-2020 Tachyon Intelligent Design Institute

import clr
clr.AddReference('ProtoGeometry')
from Autodesk.DesignScript.Geometry import *
import System
clr.AddReference('System.Windows.Forms')
from System.Windows.Forms import MessageBox

msg=IN[2]
osm=IN[3]
doc=System.Runtime.InteropServices.Marshal.GetActiveObject("Autocad.Application").ActiveDocument
rrr=None

if IN[0] == True and doc:
	try:
		if IN[1] == True:
			mbx="CamboBIM Consultant and Training Center: We have many courses such as AutoCAD, ASD, Advance Concrete, Revit, Naviswork, BIM-QS, Planning and Cost Control, Primavera P6, Project Tracker, and  Synchro Pro.Our Contact: Email: khengsengngon@gmail.com,Telephone: 069901004, Telegram:https://t.me/KHENGSENGNGORN"
			MessageBox.Show(mbx, "CamboBIM Consultant and Training Center")
		old=doc.GetVariable("osmode")
		usr=doc.GetVariable("users5")
		doc.SetVariable("osmode", int(osm))
		doc.Activate()
		doc.SendCommand("(setq pt(getpoint\042" + msg + "\042)) ")
		doc.SendCommand("(and pt(setvar\042users5\042(strcat(rtos(car pt))\042#\042(rtos(cadr pt))\042#\042(rtos(caddr pt))))(setq pt nil)) ")
		rtn=doc.GetVariable("users5")
		doc.SetVariable("osmode", old)
		if rtn != usr:
			rtn=rtn.split("#")
			if len(rtn) == 3:
				rrr=Point.ByCoordinates(float(rtn[0]),float(rtn[1]),float(rtn[2]))
				doc.SetVariable("users5", usr)
	except: pass	
OUT = rrr
# ----------------------------------------
