# Dynamo graph 03-STR_CAD2PC_V1.02.dyn (Dynamo 2.5.0.7460)
# packages: bimorphNodes 4.0.13, archi-lab.net 2023.213.1523

select_autocad = DSModelElementSelection()  # 1 picked in the model; graph input

# group: GET PILECAP CURVE BY LAYER
layerNames = Revit.ImportInstance.LayerNames(importInstance=select_autocad)
code_block = CodeBlock { "PILE CAP"; }
startsWith = String.StartsWith(str=layerNames, searchFor=code_block)
filterByBoolMask = List.FilterByBoolMask(list=layerNames, mask=startsWith)
watch = Watch(filterByBoolMask.in)
curvesFromCADLayers = CAD.CurvesFromCADLayers(importInstance=select_autocad, layerNames=watch)

# group: GROUP AND MAKE FLOOR EDGE
group_curves = Custom[Group Curves](curves=curvesFromCADLayers.Curve, lacing=Longest)  # package archi-lab.net; This node will take any input of flat list of curves and group them into sublists containing "joinable" curves that is continous curves. They might form closed curves or open curves. Use PolyCurve.ByJoinedCurves to convert output groups of curves into single PolyCurves
code_block_2 = CodeBlock { 50; }
byJoinedCurves = PolyCurve.ByJoinedCurves(curves=group_curves, joinTolerance=code_block_2)

# group: MAKE FLOOR TYPE BY LAYER NAME
watch_2 = Watch(curvesFromCADLayers.layerKeys)
code_block_3 = CodeBlock { "_"; }
split = String.Split(str=watch_2, separator0=code_block_3)
code_block_4 = CodeBlock { 1; }
getItemAtIndex = List.GetItemAtIndex(list=split, index=code_block_4, lacing=Longest)
code_block_5 = CodeBlock(a=getItemAtIndex) { a+"mm PileCap"; }
byName = FloorType.ByName(name=code_block_5)

levels = Levels("Basement Floor")  # graph input
byOutlineTypeAndLevel = Floor.ByOutlineTypeAndLevel(outline=byJoinedCurves, floorType=byName, level=levels)

# group: Message
boolean = BoolSelector(true)
code_block_6 = CodeBlock { Osmode: int = 169; }
pickPoint = Python(IN[0]=boolean, IN[1]=boolean, IN[2]=code_block_6, IN[3]=code_block_6)  # "UI.PickPoint"
# ---------- pickPoint.python (38 lines) ----------
#LinkDWG Core DYF by Koz Jono YEOH
#kozmosovia@hotmail.com
#Copyright(C) 1994-2020 KozMos Inc.
#Copyright(C) 2011-2020 Neila Heaven Networks
#Copyright(C) 2017-2020 Tachyon Intelligent Design Institute

import clr
clr.AddReference('ProtoGeometry')
from Autodesk.DesignScript.Geometry import *
import System
clr.AddReference('System.Windows.Forms')
from System.Windows.Forms import MessageBox

msg=IN[2]
osm=IN[3]
doc=System.Runtime.InteropServices.Marshal.GetActiveObject("Autocad.Application").ActiveDocument
rrr=None

if IN[0] == True and doc:
	try:
		if IN[1] == True:
			mbx="CamboBIM Consultant and Training Center: We have many courses such as AutoCAD, ASD, Advance Concrete, Revit, Naviswork, BIM-QS, Planning and Cost Control, Primavera P6, Project Tracker, and  Synchro Pro.Our Contact: Email: khengsengngon@gmail.com,Telephone: 069901004, Telegram:https://t.me/KHENGSENGNGORN"
			MessageBox.Show(mbx, "CamboBIM Consultant and Training Center")
		old=doc.GetVariable("osmode")
		usr=doc.GetVariable("users5")
		doc.SetVariable("osmode", int(osm))
		doc.Activate()
		doc.SendCommand("(setq pt(getpoint\042" + msg + "\042)) ")
		doc.SendCommand("(and pt(setvar\042users5\042(strcat(rtos(car pt))\042#\042(rtos(cadr pt))\042#\042(rtos(caddr pt))))(setq pt nil)) ")
		rtn=doc.GetVariable("users5")
		doc.SetVariable("osmode", old)
		if rtn != usr:
			rtn=rtn.split("#")
			if len(rtn) == 3:
				rrr=Point.ByCoordinates(float(rtn[0]),float(rtn[1]),float(rtn[2]))
				doc.SetVariable("users5", usr)
	except: pass	
OUT = rrr
# ----------------------------------------
