# Dynamo graph 04-STR_LEAN CONCRETE.dyn (Dynamo 2.5.0.7460)

select_model_elements = DSModelElementsSelection()  # 25 picked in the model; graph input; graph output
geometry = Element.Geometry(element=select_model_elements)
flatten = List.Flatten(list=geometry)
explode = Geometry.Explode(geometry=flatten)
code_block = CodeBlock { 0.5; }
normalAtParameter = Surface.NormalAtParameter(surface=explode, u=code_block, v=code_block)
ZAxis = Vector.ZAxis()
angleWithVector = Vector.AngleWithVector(vector=normalAtParameter, otherVector=ZAxis)
code_block_2 = CodeBlock { 180; }
eq = angleWithVector == code_block_2
filterByBoolMask = List.FilterByBoolMask(list=explode, mask=eq)
code_block_3 = CodeBlock(a=filterByBoolMask.in) { a; }
flatten_2 = List.Flatten(list=code_block_3)
perimeterCurves = Surface.PerimeterCurves(surface=flatten_2)
byJoinedCurves = PolyCurve.ByJoinedCurves(curves=perimeterCurves)
code_block_4 = CodeBlock { 200; }
offset = Curve.Offset(curve=byJoinedCurves, distance=code_block_4)
byJoinedCurves_2 = PolyCurve.ByJoinedCurves(curves=offset, lacing=Longest)
floor_types = FloorTypes("Lean Concrete")  # graph input
levels = Levels("Basement Floor")  # graph input
byOutlineTypeAndLevel = Floor.ByOutlineTypeAndLevel(outline=byJoinedCurves_2, floorType=floor_types, level=levels)

# group: Message
boolean = BoolSelector(true)
code_block_5 = CodeBlock { Osmode: int = 169; }
pickPoint = Python(IN[0]=boolean, IN[1]=boolean, IN[2]=code_block_5, IN[3]=code_block_5)  # "UI.PickPoint"
# ---------- pickPoint.python (38 lines) ----------
#LinkDWG Core DYF by Koz Jono YEOH
#kozmosovia@hotmail.com
#Copyright(C) 1994-2020 KozMos Inc.
#Copyright(C) 2011-2020 Neila Heaven Networks
#Copyright(C) 2017-2020 Tachyon Intelligent Design Institute

import clr
clr.AddReference('ProtoGeometry')
from Autodesk.DesignScript.Geometry import *
import System
clr.AddReference('System.Windows.Forms')
from System.Windows.Forms import MessageBox

msg=IN[2]
osm=IN[3]
doc=System.Runtime.InteropServices.Marshal.GetActiveObject("Autocad.Application").ActiveDocument
rrr=None

if IN[0] == True and doc:
	try:
		if IN[1] == True:
			mbx="CamboBIM Consultant and Training Center: We have many courses such as AutoCAD, ASD, Advance Concrete, Revit, Naviswork, BIM-QS, Planning and Cost Control, Primavera P6, Project Tracker, and  Synchro Pro.Our Contact: Email: khengsengngon@gmail.com,Telephone: 069901004, Telegram:https://t.me/KHENGSENGNGORN"
			MessageBox.Show(mbx, "CamboBIM Consultant and Training Center")
		old=doc.GetVariable("osmode")
		usr=doc.GetVariable("users5")
		doc.SetVariable("osmode", int(osm))
		doc.Activate()
		doc.SendCommand("(setq pt(getpoint\042" + msg + "\042)) ")
		doc.SendCommand("(and pt(setvar\042users5\042(strcat(rtos(car pt))\042#\042(rtos(cadr pt))\042#\042(rtos(caddr pt))))(setq pt nil)) ")
		rtn=doc.GetVariable("users5")
		doc.SetVariable("osmode", old)
		if rtn != usr:
			rtn=rtn.split("#")
			if len(rtn) == 3:
				rrr=Point.ByCoordinates(float(rtn[0]),float(rtn[1]),float(rtn[2]))
				doc.SetVariable("users5", usr)
	except: pass	
OUT = rrr
# ----------------------------------------
