# Dynamo graph 05-STR_EXCEL2SECTION_CO&BM.dyn (Dynamo 2.5.0.7460)
# packages: Rhythm 2017.9.6, Clockwork for Dynamo 2.x 2.4.0

family_types = FamilyTypes("M_Concrete-Rectangular-Column:650 x 650mm")  # graph input
code_block = CodeBlock { "-"; }
list_create = List.Create()  # unwired: item0, item1
file_path = Filename("..\CamBIM-BeamTypeGenerator\BeamSchedule.xlsx")  # graph input
file_from_path = FileObject(path=file_path)
string = StringInput("schedule")
importExcel = Data.ImportExcel(file=file_from_path, sheetName=string)
deconstruct = List.Deconstruct()  # unwired: list
map = List.Map(list=importExcel, f_x=deconstruct.first)
code_block_2 = CodeBlock { "x"; }
deconstruct_2 = List.Deconstruct()  # unwired: list
map_2 = List.Map(list=importExcel, f_x=deconstruct_2.rest)
string_from_object = FromObject(obj=map_2)
code_block_3 = CodeBlock { ".000000"; ""; }
replace = String.Replace(str=string_from_object, searchFor=code_block_3.out0, replaceWith=code_block_3.out1)
join = String.Join(separator=code_block_2, string0=replace)
flatten = List.Flatten(list=join)
laceLongest = List.LaceLongest(comb=list_create, list1=map, list2=flatten)
join_2 = String.Join(separator=code_block, string0=laceLongest)
flatten_2 = List.Flatten(list=join_2)
duplicate = Custom[FamilyType.Duplicate](elementType=family_types, name=flatten_2, lacing=CrossProduct)  # package Clockwork for Dynamo 2.x; Duplicates a family type
code_block_4 = CodeBlock { "b"; }
deconstruct_3 = List.Deconstruct()  # unwired: list
map_3 = List.Map(list=map_2, f_x=deconstruct_3.first)
setparameterbyname = Custom[SetParameterByName(TypeOrInstance)](element=duplicate, parameterName=code_block_4, value=map_3, lacing=Longest)  # package Rhythm; Set one of the element's parameters regardless of parameter type or instance.
code_block_5 = CodeBlock { "h"; }
deconstruct_4 = List.Deconstruct()  # unwired: list
map_4 = List.Map(list=map_2, f_x=deconstruct_4.rest)
setparameterbyname_2 = Custom[SetParameterByName(TypeOrInstance)](element=setparameterbyname, parameterName=code_block_5, value=map_4, lacing=Longest)

# group: Message
boolean = BoolSelector(true)
code_block_6 = CodeBlock { Osmode: int = 169; }
pickPoint = Python(IN[0]=boolean, IN[1]=boolean, IN[2]=code_block_6, IN[3]=code_block_6)  # "UI.PickPoint"
# ---------- pickPoint.python (38 lines) ----------
#LinkDWG Core DYF by Koz Jono YEOH
#kozmosovia@hotmail.com
#Copyright(C) 1994-2020 KozMos Inc.
#Copyright(C) 2011-2020 Neila Heaven Networks
#Copyright(C) 2017-2020 Tachyon Intelligent Design Institute

import clr
clr.AddReference('ProtoGeometry')
from Autodesk.DesignScript.Geometry import *
import System
clr.AddReference('System.Windows.Forms')
from System.Windows.Forms import MessageBox

msg=IN[2]
osm=IN[3]
doc=System.Runtime.InteropServices.Marshal.GetActiveObject("Autocad.Application").ActiveDocument
rrr=None

if IN[0] == True and doc:
	try:
		if IN[1] == True:
			mbx="CamboBIM Consultant and Training Center: We have many courses such as AutoCAD, ASD, Advance Concrete, Revit, Naviswork, BIM-QS, Planning and Cost Control, Primavera P6, Project Tracker, and  Synchro Pro.Our Contact: Email: khengsengngon@gmail.com,Telephone: 069901004, Telegram:https://t.me/KHENGSENGNGORN"
			MessageBox.Show(mbx, "CamboBIM Consultant and Training Center")
		old=doc.GetVariable("osmode")
		usr=doc.GetVariable("users5")
		doc.SetVariable("osmode", int(osm))
		doc.Activate()
		doc.SendCommand("(setq pt(getpoint\042" + msg + "\042)) ")
		doc.SendCommand("(and pt(setvar\042users5\042(strcat(rtos(car pt))\042#\042(rtos(cadr pt))\042#\042(rtos(caddr pt))))(setq pt nil)) ")
		rtn=doc.GetVariable("users5")
		doc.SetVariable("osmode", old)
		if rtn != usr:
			rtn=rtn.split("#")
			if len(rtn) == 3:
				rrr=Point.ByCoordinates(float(rtn[0]),float(rtn[1]),float(rtn[2]))
				doc.SetVariable("users5", usr)
	except: pass	
OUT = rrr
# ----------------------------------------
