# Dynamo graph 06-STR-ARC-CAD2WALL.dyn (Dynamo 2.5.0.7460)
# packages: bimorphNodes 4.0.13, Clockwork for Dynamo 2.x 2.4.0

select_dwg = DSModelElementSelection()  # 1 picked in the model; graph input
wall_layer_use_for_multiple = StringInput("W1")  # "Wall Layer (Use","for multiple layers)"; graph input
code_block = CodeBlock { ","; }
split = String.Split(str=wall_layer_use_for_multiple, separator0=code_block)
# note: BimorphNodes Package
curvesFromCADLayers = CAD.CurvesFromCADLayers(importInstance=select_dwg, layerNames=split)
flatten = List.Flatten(list=curvesFromCADLayers.Curve)

# group: Cleaning Wall Line (Dry Wall)
merge_overlapped_lines = Python(IN[0]=flatten)
# ---------- merge_overlapped_lines.python (78 lines) ----------
# Enable Python support and load DesignScript library
import clr
clr.AddReference('ProtoGeometry')
from Autodesk.DesignScript.Geometry import *

# The inputs to this node will be stored as a list in the IN variables.
dataEnteringNode = IN

# Place your code below this line
data=IN[0]
groups=[]
outlist=[]
newlines=[]
lines=[]
list=[]
#repeat until list is empty
for x in data:
	try:
		x.Direction
		list.append(x)
	except:
		pass
		
		
while len(list)!=0:
	group=[list[0]]
	del list[0]
	n1=0
	#make intersect groups from items in the list
	while n1+1<=len(group):
		x=(group[n1])
		vx=x.Direction
		for y in list:
			if x.DoesIntersect(y):
				vy=y.Direction
				if vx.IsParallel(vy):
					group.append(y)
					list.remove(y)
		n1=n1+1
	groups.append(group)


for grp in groups:
	points=[]
	for line in grp:#collect StartPoint and EndPoint
		point=line.StartPoint
		points.append(point)
		point=line.EndPoint
		points.append(point)
	#find two far points
	x=points[0]
	dist=0
	for p1 in points:
		newdist=p1.DistanceTo(x)
		if newdist>=dist:
			dist=newdist
			bp1=p1
	dist=0
	for p1 in points:
		newdist=p1.DistanceTo(bp1)
		if newdist>=dist:
			dist=newdist
			bp2=p1
	#make new line from far points
	newline=Line.ByStartPointEndPoint(bp1,bp2)
	newlines.append(newline)
	
#regulate direction of lines
for x in newlines:
	v1=x.Direction
	if round(v1.X)<0:
		x=Curve.Reverse(x)
	if round(v1.X)==0 and round(v1.Y)<0:
		x=Curve.Reverse(x)
	outlist.append(x)
		
# Assign your output to the OUT variable.
OUT = outlist
# ----------------------------------------
max_wall_width = CodeBlock { 200; }
remove_short_lines = Python(IN[0]=merge_overlapped_lines, IN[1]=max_wall_width)
# ---------- remove_short_lines.python (20 lines) ----------
# Enable Python support and load DesignScript library
import clr
clr.AddReference('ProtoGeometry')
from Autodesk.DesignScript.Geometry import *

# The inputs to this node will be stored as a list in the IN variables.
dataEnteringNode = IN
lines=IN[0]
max=IN[1]
outlist=[]
max=max/2
for x in lines:
	lng=x.Length
	if lng>=max:
		outlist.append(x)
	
# Place your code below this line

# Assign your output to the OUT variable.
OUT = outlist
# ----------------------------------------
removeEdgeLine = Python(IN[0]=remove_short_lines, IN[1]=max_wall_width)
# ---------- removeEdgeLine.python (38 lines) ----------
# Enable Python support and load DesignScript library
import clr
clr.AddReference('ProtoGeometry')
from Autodesk.DesignScript.Geometry import *

# The inputs to this node will be stored as a list in the IN variables.
dataEnteringNode = IN

# Place your code below this line
lines=IN[0]
max=IN[1]
outlist=[]
for l1 in lines:
	outlist.append(l1)
min=max*1.2
ind=0
while ind<len(lines):
	x=lines[ind]
	if x.Length<=min:
		xl=round(x.Length)
		pt1=x.PointAtParameter(0.5)
		ccl=Circle.ByCenterPointRadius(pt1,(xl/2)+2)
		sublist=[]
		for y in lines:
			if ccl.DoesIntersect(y):
				sublist.append(y)
		if len(sublist)==2:
			pt2=ccl.Intersect(sublist[0])
			pt3=ccl.Intersect(sublist[1])		
			d1=round(pt2[0].DistanceTo(pt3[0]))
			
			if d1==xl:
				
				outlist.remove(x)
	ind=ind+1	

# Assign your output to the OUT variable.
OUT = outlist
# ----------------------------------------
group_aligned_lines = Python(IN[0]=removeEdgeLine)
# ---------- group_aligned_lines.python (56 lines) ----------
# Enable Python support and load DesignScript library
import clr
clr.AddReference('ProtoGeometry')
from Autodesk.DesignScript.Geometry import *

# The inputs to this node will be stored as a list in the IN variables.
dataEnteringNode = IN

# Place your code below this line
lines=IN[0]

# define Align
def alnd(a,b):
	pt0=a.PointAtParameter(0)
	v1=Curve.NormalAtParameter(a,0)
	plane1=Plane.ByOriginNormal(pt0,v1)
	pt1=b.PointAtParameter(0)
	pt2=b.PointAtParameter(1)
	bl1=(plane1.DistanceTo(pt1))<5
	bl2=(plane1.DistanceTo(pt2))<5
	#bl1=(plane1.DoesIntersect(pt1))
	#bl2=(plane1.DoesIntersect(pt2))
	if bl1==True and bl2==True:
		return True
	else:
		return False

outlist=[]


while len(lines)!=0:
	
	group=[lines[0]]
	baseline=group[0]
	del lines[0]
	int=0
	num=[]
	while int+1<=len(lines):
		x=lines[int]
		if alnd(baseline,x)==True:
			group.append(x)
			num.append(int)
			lines.remove(x)
			
		else:
			int=int+1
	
	
				
	outlist.append(group)
	group=[]
	

	
# Assign your output to the OUT variable.
OUT = outlist
# ----------------------------------------
regulatedirection_and_reorder = Python(IN[0]=group_aligned_lines)  # "RegulateDirection and Reorder LInes"
# ---------- regulatedirection_and_reorder.python (70 lines) ----------
# Enable Python support and load DesignScript library
import clr
clr.AddReference('ProtoGeometry')
from Autodesk.DesignScript.Geometry import *

# The inputs to this node will be stored as a list in the IN variables.
dataEnteringNode = IN

# Place your code below this line
list=IN[0]
outlist=[]

def new(x):
	v1=x.Direction
	if round(v1.X)<0:
		x=Curve.Reverse(x)
	if round(v1.X)==0 and round(v1.Y)<0:
		x=Curve.Reverse(x)
	return x

def reorder(lines):

	alines=[]
	xp=[]
	xp2=[]
	indx=[]
	v=lines[0].Direction
	if v.X>0:
		for x in lines:
			xp.append(x.StartPoint.X)
	else:
		for x in lines:
			xp.append(x.StartPoint.Y)
	for x in xp:
		xp2.append(x)
	xp.sort()
	for x in xp2:
		a=xp.index(x)
		indx.append(a)
	ind=0
	while ind<len(lines):
		x=indx.index(ind)
		alines.append(lines[x])
		ind=ind+1
	return alines

for a in list:
	try:
		a=new(a)
		outlist.append(a)
	except:
		sublist=[]
		for b in a:
			b=new(b)
			sublist.append(b)
		outlist.append(sublist)

try:
	alines=reorder(outlist)
	relist=alines
except:
	relist=[]
	for x in outlist:
		alines=reorder(x)
		relist.append(alines)
	
	
		
# Assign your output to the OUT variable.
OUT = relist
# ----------------------------------------
connectNearAlignedLines = Python(IN[0]=regulatedirection_and_reorder, IN[1]=max_wall_width)
# ---------- connectNearAlignedLines.python (57 lines) ----------
# Enable Python support and load DesignScript library
import clr
clr.AddReference('ProtoGeometry')
from Autodesk.DesignScript.Geometry import *

# The inputs to this node will be stored as a list in the IN variables.
dataEnteringNode = IN

# Place your code below this line
data=IN[0]
max=IN[1]
max=max*1.2
def connect(a,b):#make one line from two aligned lines
	p1=a.PointAtParameter(0)
	p2=b.PointAtParameter(1)
	new=Line.ByStartPointEndPoint(p1,p2)
	return new
def tester(a,b):
	p1=a.PointAtParameter(1)
	p2=b.PointAtParameter(0)
	new=Line.ByStartPointEndPoint(p1,p2)
	return new
def newlist(list,max):#
	ind=1
	new=[]
	l1=list[0]
	new.append(l1)
	while ind<len(list):
		l2=list[ind]
		d1=l2.DistanceTo(l1)
		testline=tester(l1,l2)
		test=True
		
		if d1<=max and test==True:
		
			new.remove(l1)
			l1=connect(l1,l2)
			new.append(l1)
			ind=ind+1
		
		else:
			l1=l2
			new.append(l1)
			l1=list[ind]
			ind=ind+1
	return new
	
try:
	data=newlist(data,max)
	outlist=data
except:
	outlist=[]
	for a in data:
		subdata=newlist(a,max)
		outlist.append(subdata)
# Assign your output to the OUT variable.
OUT = outlist
# ----------------------------------------

flatten_2 = List.Flatten(list=connectNearAlignedLines)

# group: Extend Short "Z" connected lines
extend_short_lines = Python(IN[0]=flatten_2, IN[1]=max_wall_width)
# ---------- extend_short_lines.python (89 lines) ----------
# Enable Python support and load DesignScript library
import clr
clr.AddReference('ProtoGeometry')
from Autodesk.DesignScript.Geometry import *

# The inputs to this node will be stored as a list in the IN variables.
dataEnteringNode = IN
def new(x):
	v1=x.Direction
	if round(v1.X)<0:
		x=Curve.Reverse(x)
	if round(v1.X)==0 and round(v1.Y)<0:
		x=Curve.Reverse(x)
	return x
def ctl(curve): #Curve To Line
	spt=curve.StartPoint
	ept=curve.EndPoint
	line=Line.ByStartPointEndPoint(spt,ept)
	return line
# Place your code below this line
lines=IN[0]
max=IN[1]
outlist=[]
shortlist=[]
semilist=[]
min=max*1.2
for l1 in lines:
	l1=new(l1)
	lng=l1.Length

	if lng<=min and lng>25:
		pt=l1.PointAtParameter(0.5)
		radius=round(lng/2+2)
		ccl=Circle.ByCenterPointRadius(pt,radius)

		points=[]

		for l2 in lines:
			spt=l2.StartPoint
			ept=l2.EndPoint
			if ccl.DoesIntersect(l2):# or l1.DoesIntersect(ept):
				point=l2.Intersect(ccl)[0]
				points.append(point)
				
				
		if len(points)==2:
			dia=points[1].DistanceTo(points[0])
			if dia/2>radius-1:
				shortlist.append(l1)
	
	else:
		outlist.append(l1)
shorts=[]
for s in shortlist:
	vs=s.Direction
	for x in shortlist:
		vx=x.Direction
		dist=s.DistanceTo(x)
		if vs.IsParallel(vx) and dist>50 and dist<300:
			shorts.append([s,x])
			shortlist.remove(x)
			shortlist.remove(s)
			break;
shortlines=[]
for cp in shorts:
	spt0=cp[0].StartPoint
	ept0=cp[0].EndPoint
	v0=cp[0].Direction
	spt1=cp[1].StartPoint
	ept1=cp[1].EndPoint
	v1=cp[1].Direction
	plane0=Plane.ByOriginNormal(spt0,v0)
	plane1=Plane.ByOriginNormal(ept0,v0)
	
	dist0=plane0.DistanceTo(cp[1])
	dist1=plane1.DistanceTo(cp[1])
	if dist0>dist1:
		l0=cp[0].ExtendEnd(dist0)
		l1=cp[1].ExtendStart(dist0)
		
	else:
		l0=cp[0].ExtendStart(dist1)
		l1=cp[1].ExtendEnd(dist1)
	l0=ctl(l0)
	l1=ctl(l1)
	outlist.append(l0)
	outlist.append(l1)
# Assign your output to the OUT variable.
OUT = outlist
# ----------------------------------------

remove_unnecessary_inner_lines = Python(IN[0]=extend_short_lines, IN[1]=max_wall_width)
# ---------- remove_unnecessary_inner_lines.python (31 lines) ----------
# Enable Python support and load DesignScript library
import clr
clr.AddReference('ProtoGeometry')
from Autodesk.DesignScript.Geometry import *

# The inputs to this node will be stored as a list in the IN variables.
dataEnteringNode = IN

# Place your code below this line
lines=IN[0]
max=IN[1]
outlist=[]
for line in lines:
	mpt=line.PointAtParameter(0.5)
	v=line.NormalAtParameter(0.5)
	test1=Line.ByStartPointDirectionLength(mpt,v,max)
	test2=Line.ByStartPointDirectionLength(mpt,v,-max)
	t1=0
	t2=0
	for x in lines:
		v2=x.NormalAtParameter(0.5)
		if v.IsParallel(v2):
			if test1.DoesIntersect(x):
				t1=t1+1
			if test2.DoesIntersect(x):
				t2=t2+1
	if t1==1 or t2==1:
		outlist.append(line)
		
# Assign your output to the OUT variable.
OUT = outlist
# ----------------------------------------

# group: Gnerate Location & Width of Walls
length = Curve.Length()  # unwired: curve
sortByFunction = List.SortByFunction(list=remove_unnecessary_inner_lines, func=length)
eachCenterLineAndWidth = Python(IN[0]=sortByFunction)
# ---------- eachCenterLineAndWidth.python (62 lines) ----------
# Enable Python support and load DesignScript library
import clr
clr.AddReference('ProtoGeometry')
from Autodesk.DesignScript.Geometry import *

# The inputs to this node will be stored as a list in the IN variables.
dataEnteringNode = IN


# Place your code below this line
data=IN[0]
def centerline(a,b):
	spt1=a.PointAtParameter(0)
	spt2=b.PointAtParameter(0)
	ept1=a.PointAtParameter(1)
	ept2=b.PointAtParameter(1)
	line1=Line.ByStartPointEndPoint(spt1,spt2)
	line2=Line.ByStartPointEndPoint(ept1,ept2)
	spt3=line1.PointAtParameter(0.5)
	ept3=line2.PointAtParameter(0.5)
	center=Line.ByStartPointEndPoint(spt3,ept3)
def EachCenter(lines):
	cenlist=[]
	widthlist=[]
	olist=[]
	while len(lines)!=0:
		ind=0
		l1=lines[0]
		del lines[0]
		p1=l1.PointAtParameter(0.5)
		#dr1=l1.Direction
		v1=l1.NormalAtParameter(0.5)
		v2=Vector.Reverse(v1)
		lv1=Line.ByStartPointDirectionLength(p1,v1,300)
		lv2=Line.ByStartPointDirectionLength(p1,v2,300)
		
		for x in lines:
			d1=round(l1.DistanceTo(x))
			#dr2=x.Direction
			if x.DoesIntersect(lv1):# and dr1.IsAlmostEqualTo(dr2):
				l2=l1.Translate(v1,d1/2)
				cenlist.append(l2)
				widthlist.append(d1)
			elif x.DoesIntersect(lv2):# and dr1.IsAlmostEqualTo(dr2):
				l2=l1.Translate(v2,d1/2)
				cenlist.append(l2)
				widthlist.append(d1)
					
	olist.append(cenlist)
	olist.append(widthlist)
	return olist
try:
	newlist=EachCenter(data)
except:
	newlist=[]
	for lines in data:
		nlist=EachCenter(lines)
		newlist.append(nlist)
	
		
# Assign your output to the OUT variable.
OUT = newlist
# ----------------------------------------

# group: Wall Location Line
firstItem = List.FirstItem(list=eachCenterLineAndWidth)

levels = Levels("Level 1")  # graph input
levels_2 = Levels("Level 2")  # graph input

# group: Wall Width
lastItem = List.LastItem(list=eachCenterLineAndWidth)

# group: Generate Wall Types with Auto Naming from Width
walltype_to_duplicate = WallTypes("D_200")  # graph input
string_from_object = FromObject(obj=lastItem)
code_block_2 = CodeBlock { ".000000"; ""; }
replace = String.Replace(str=string_from_object, searchFor=code_block_2.out0, replaceWith=code_block_2.out1)
code_block_3 = CodeBlock { 0; }
prefix_for_dry_walltype = StringInput("D_")  # graph input
insert = String.Insert(str=replace, index=code_block_3, toInsert=prefix_for_dry_walltype)
# note: Clockwork Package
duplicate = Custom[FamilyType.Duplicate](elementType=walltype_to_duplicate, name=insert, lacing=Longest)  # package Clockwork for Dynamo 2.x; Duplicates a family type

# group: Set WallType Width
code_block_4 = CodeBlock { 0; }
# note: Clockwork Package
setCompoundLayerWidth = Custom[FamilyType.SetCompoundLayerWidth](familyType=duplicate, layerIndex=code_block_4, width=lastItem, lacing=Longest)  # package Clockwork for Dynamo 2.x; Sets the width of a specified compound layer of a given family type (only applies to family types that have a compound structure, e.g. walls, floors etc.).

# group: Generate Walls
byCurveAndLevels = Wall.ByCurveAndLevels(curve=firstItem, startLevel=levels, endLevel=levels_2, wallType=setCompoundLayerWidth.familyType)
string = StringInput("Structural")
code_block_5 = CodeBlock { 0; }
setParameterByName = Element.SetParameterByName(element=byCurveAndLevels, parameterName=string, value=code_block_5)
end = Revit.Transaction.Transaction.End(input=setParameterByName)

# group: Message
boolean = BoolSelector(true)
code_block_6 = CodeBlock { Osmode: int = 169; }
pickPoint = Python(IN[0]=boolean, IN[1]=boolean, IN[2]=code_block_6, IN[3]=code_block_6)  # "UI.PickPoint"
# ---------- pickPoint.python (38 lines) ----------
#LinkDWG Core DYF by Koz Jono YEOH
#kozmosovia@hotmail.com
#Copyright(C) 1994-2020 KozMos Inc.
#Copyright(C) 2011-2020 Neila Heaven Networks
#Copyright(C) 2017-2020 Tachyon Intelligent Design Institute

import clr
clr.AddReference('ProtoGeometry')
from Autodesk.DesignScript.Geometry import *
import System
clr.AddReference('System.Windows.Forms')
from System.Windows.Forms import MessageBox

msg=IN[2]
osm=IN[3]
doc=System.Runtime.InteropServices.Marshal.GetActiveObject("Autocad.Application").ActiveDocument
rrr=None

if IN[0] == True and doc:
	try:
		if IN[1] == True:
			mbx="CamboBIM Consultant and Training Center: We have many courses such as AutoCAD, ASD, Advance Concrete, Revit, Naviswork, BIM-QS, Planning and Cost Control, Primavera P6, Project Tracker, and  Synchro Pro.Our Contact: Email: khengsengngon@gmail.com,Telephone: 069901004, Telegram:https://t.me/KHENGSENGNGORN"
			MessageBox.Show(mbx, "CamboBIM Consultant and Training Center")
		old=doc.GetVariable("osmode")
		usr=doc.GetVariable("users5")
		doc.SetVariable("osmode", int(osm))
		doc.Activate()
		doc.SendCommand("(setq pt(getpoint\042" + msg + "\042)) ")
		doc.SendCommand("(and pt(setvar\042users5\042(strcat(rtos(car pt))\042#\042(rtos(cadr pt))\042#\042(rtos(caddr pt))))(setq pt nil)) ")
		rtn=doc.GetVariable("users5")
		doc.SetVariable("osmode", old)
		if rtn != usr:
			rtn=rtn.split("#")
			if len(rtn) == 3:
				rrr=Point.ByCoordinates(float(rtn[0]),float(rtn[1]),float(rtn[2]))
				doc.SetVariable("users5", usr)
	except: pass	
OUT = rrr
# ----------------------------------------
